# Requirement set controller (R2021b)

## 1 [HLR1] System initialization
Upon resumption of power to the controller, no signals shall be displayed for a time not less than x seconds nor greater than y seconds before normal operations begin.

### 1.1 [HLR1.1] Startup delay condition
If the system has already been turned off for more than x seconds, the system shall skip the start up delay. Otherwise, the system shall start operations only after a fixed delay.

### 1.2 [HLR1.2] Resumption of normal operations
The controller shall resume operation at "Vehicles Passing Ready" phase. That is, a yellow light signal for the vehicle light set and a red light signal for the pedestrian light set.

## 2 [HLR2] Default light signals
The traffic lights for both carriageways shall remain in one default configuration until a call button on either side of the carriageway is pressed. This configuration is green for the vehicle light set and red for the pedestrian light set.

## 3 [HLR3] Call button response (Container)
When the call button on either carriageway is pressed, the system shall initiate the sequence for light transition to green for pedestrians and red for motorists.

### 3.1 [HLR3.1] Pedestrian crossing wait time
When the call button on either carriageway is pressed, the system shall signal the pedestrian to cross in no longer than x seconds.

### 3.2 [HLR3.2] Dual carriageway response
The system shall automatically trigger a button press on the other carriageway after x seconds when the call button on either carriageway is pressed

### 3.3 [HLR3.3] Button request during light sequence
When the call button on either carriageway is pressed and the light sequence has initiated, the system shall not service any new requests.

## 4 [HLR5] Traffic lights regime
The traffic lights shall be switched based on the standard lights regime: Green - Yellow - Red and vice versa. The yellow lights must always be between the green and red lights transitions.

### 4.1 [HLR5.1] Green signal sonstraint
The vehicle and pedestrian light set on one carriageway must never be green at the same time.

### 4.2 [HLR5.2] Single light display on light set at a given time
When the light switching occurs, each signal head must display no more than one light signal at a time.

### 4.3 [HLR5.3] Vehicle Passing Efficiency
x seconds after the pedestrian light set has been switched to red, vehicle light set shall be switched to green.